# Grasshopper definition Strand7_BHoM_example.gh (Grasshopper 1.0.7)
# plug-ins: BH.UI.Grasshopper

# ----
# MATERIAL
concrete = Concrete(
    Name="Fc40",
    YoungsModulus=3.3e+10,
    PoissonsRatio=0.2,
    ThermalExpansionCoeff=1e-05,
    Density=2550,
    DampingRatio=0,
    CubeStrength="40",
    CylinderStrength="40",
    Component="{ .Concrete")

floors = Slider(15, range=2..30)
span_x = Slider(33, range=20..60, expression="x*0.2")
span_x_2 = Slider(35, range=20..60, expression="x*0.2")
spans_x = Slider(3, range=2..20)
spans_y = Slider(5, range=2..20)
floor_height = Slider(32, range=20..40, expression="x*0.1")

recgrid = Rectangular(Plane=PlaneXY(0, 0, 0), SizeX=span_x, SizeY=span_x_2, ExtentX=spans_x, ExtentY=spans_y)  # -> flatten(Cells), Points
Z = UnitZ(Factor=floor_height)
boundary = BoundarySurfaces(Edges=recgrid.Cells)
arrlinear = LinearArray(Geometry=flatten(recgrid.Points), Direction=Z, Count=floors)  # -> Geometry, Transform
arrlinear_2 = LinearArray(Geometry=boundary, Direction=Z, Count=floors)  # -> Geometry, Transform
# GEOMETRY
flip = FlipMatrix(Data=arrlinear_2.Geometry)
flip_2 = FlipMatrix(Data=arrlinear.Geometry)
tstat = TreeStatistics(Tree=flip)  # -> Paths, Length, Count
relitem = RelativeItem(Tree=simplify(flip_2), Offset="{+1}", WrapPaths=False, WrapItems=False)  # -> ItemA, ItemB
cull_i = CullIndex(List=tstat.Paths, Indices="0", Wrap=True)
ln = Line(StartPoint=relitem.ItemA, EndPoint=relitem.ItemB)
branch = TreeBranch(Tree=flip, Path=cull_i, MaintainPaths=True)
geo_slab_surfaces = Geometry(flatten(branch))
mesh_uv = MeshSurface(Surface=geo_slab_surfaces, UCount=5, VCount=5, Overhang=True, Equalize=False)
mjoin = MeshJoin(Meshes=mesh_uv)

# ----
# ADAPTER
strand7adapter = Strand7Adapter(Initialise=Toggle(False), Tolerance=0.1, Component="{ ..ctor")
adapter_strand7 = BHoMAdapter(
    strand7adapter,
    ObjectType="{ \"_t\" : \"System.Type\", \"Name\" : \"System.Object, mscorlib, Version=4.0.0.0, Culture=neutral, PublicKeyToken=b77a5c561934e089\" }",
    m_ForcePreview=False,
    m_MaxItemsPreview=10000)

# ----
# NEW FILE
st7newfile = St7NewFile(
    FileName="ParametricModel.ST7",
    FileDir="C:\Users\dmitry.zelenkin\Desktop\STRAND7_TEMP",
    Active=Toggle(False),
    Component="{ .St7NewFile")
st7unitenum = St7UnitEnum({"N_mm": 0, "kN_m": 1}, selected="N_mm", Component="BH.oM.Adapter.Strand7.St7UnitEnum", Selection=0)
st7units = St7Units(Active=st7newfile, St7UnitEnum=st7unitenum, Component="{ .St7Units")

pt_points_columns = Point(flip_2)
pt_points_columns_2 = Point(pt_points_columns)

tstat_2 = TreeStatistics(Tree=pt_points_columns_2)  # -> Paths, Length, Count
item = ListItem(List=tstat_2.Paths, Index=0, Wrap=True)
fixconstraint6dof = FixConstraint6DOF(Name="Fix", Component="{ .FixConstraint6DOF")
# RESTRAINTS
branch_2 = TreeBranch(Tree=pt_points_columns_2, Path=item, MaintainPaths=True)
node = Node(Coordinates=branch_2, FreedomeCase="1", Support=fixconstraint6dof, Component="{ .Node")

adapter_strand7_2 = BHoMAdapter(
    adapter_strand7,
    ObjectType="{ \"_t\" : \"System.Type\", \"Name\" : \"System.Object, mscorlib, Version=4.0.0.0, Culture=neutral, PublicKeyToken=b77a5c561934e089\" }",
    m_ForcePreview=False,
    m_MaxItemsPreview=10000)
# PUSH
push = Push(
    Adapter=adapter_strand7_2,
    Objects=flatten(node),
    PushType="{ \"_t\" : \"System.Enum\", \"TypeName\" : { \"_t\" : \"System.Type\", \"Name\" : \"BH.oM.Adapter.PushType\" }, \"Value\" : \"AdapterDefault\" }",
    Active=st7units,
    Component="{ .Push")  # -> Objects, Success

geo_structural_column_lines = Geometry(ln)
geo_structural_column_lines_2 = Geometry(flatten(geo_structural_column_lines))

# ----
# COLUMNS
concreterectanglesection = ConcreteRectangleSection(
    Height="0.450",
    Width="0.450",
    Material=concrete,
    Name="sq 450x450",
    MinimumCover=0,
    Component="{ .ConcreteRectangleSection")
bar = Bar(
    Line=geo_structural_column_lines_2,
    SectionProperty=concreterectanglesection,
    OrientationAngle=0,
    FeaType="{ \"_t\" : \"System.Enum\", \"TypeName\" : { \"_t\" : \"System.Type\", \"Name\" : \"BH.oM.Structure.Elements.BarFEAType\" }, \"Value\" : \"Flexural\" }",
    Component="{ .Bar")

curvepoint = PointOnCurve(geo_structural_column_lines_2, parameter=0.5)
pdecon = Deconstruct(Point=curvepoint)  # -> XComponent, YComponent, ZComponent
equals = Equality(FirstNumber=pdecon.XComponent, SecondNumber="0")  # -> Equality, Inequality
loadnature = LoadNature(
    {"Dead": 0, "SuperDead": 1, "Live": 2, "Wind": 3, "Seismic": 4, "Temperature": 5, "Snow": 6, "Accidental": 7, "Prestress": 8, "Notional": 9, "Other": 10}, selected="Wind",
    Component="BH.oM.Structure.Loads.LoadNature",
    Selection=3)
loadnature_2 = LoadNature(
    {"Dead": 0, "SuperDead": 1, "Live": 2, "Wind": 3, "Seismic": 4, "Temperature": 5, "Snow": 6, "Accidental": 7, "Prestress": 8, "Notional": 9, "Other": 10}, selected="Dead",
    Component="BH.oM.Structure.Loads.LoadNature",
    Selection=0)
loadnature_3 = LoadNature(
    {"Dead": 0, "SuperDead": 1, "Live": 2, "Wind": 3, "Seismic": 4, "Temperature": 5, "Snow": 6, "Accidental": 7, "Prestress": 8, "Notional": 9, "Other": 10}, selected="Live",
    Component="BH.oM.Structure.Loads.LoadNature",
    Selection=2)
mesh_slabs = Mesh(mjoin)
# SLABS
mesh_slabs_2 = Mesh(mesh_slabs)

paneltype = PanelType(
    {"Undefined": 0, "Slab": 1, "Wall": 2, "PileCap": 3, "DropPanel": 4}, selected="Slab",
    Component="BH.oM.Structure.SurfaceProperties.PanelType",
    Selection=1)
constantthickness = ConstantThickness(
    Name="Slab 200mm",
    Thickness="0.200",
    Material=concrete,
    PanelType=paneltype,
    Component="BH.oM.Structure.SurfaceProperties.ConstantThickness")
femesh = FEMesh(Mesh=mesh_slabs_2, Property=constantthickness, Component="{ .FEMesh")

adapter_strand7_3 = BHoMAdapter(
    adapter_strand7,
    ObjectType="{ \"_t\" : \"System.Type\", \"Name\" : \"System.Object, mscorlib, Version=4.0.0.0, Culture=neutral, PublicKeyToken=b77a5c561934e089\" }",
    m_ForcePreview=False,
    m_MaxItemsPreview=10000)
# PUSH
push_2 = Push(
    Adapter=adapter_strand7_3,
    Objects=flatten(femesh),
    PushType="{ \"_t\" : \"System.Enum\", \"TypeName\" : { \"_t\" : \"System.Type\", \"Name\" : \"BH.oM.Adapter.PushType\" }, \"Value\" : \"AdapterDefault\" }",
    Active=push.Success,
    Component="{ .Push")  # -> Objects, Success

adapter_strand7_4 = BHoMAdapter(
    adapter_strand7,
    ObjectType="{ \"_t\" : \"System.Type\", \"Name\" : \"System.Object, mscorlib, Version=4.0.0.0, Culture=neutral, PublicKeyToken=b77a5c561934e089\" }",
    m_ForcePreview=False,
    m_MaxItemsPreview=10000)
# PUSH
push_3 = Push(
    Adapter=adapter_strand7_4,
    Objects=flatten(bar),
    PushType="{ \"_t\" : \"System.Enum\", \"TypeName\" : { \"_t\" : \"System.Type\", \"Name\" : \"BH.oM.Adapter.PushType\" }, \"Value\" : \"AdapterDefault\" }",
    Active=push_2.Success,
    Component="{ .Push")  # -> Objects, Success

cull = CullPattern(List=push_3.Objects, CullPattern=equals.Equality)

adapter_strand7_5 = BHoMAdapter(
    adapter_strand7,
    ObjectType="{ \"_t\" : \"System.Type\", \"Name\" : \"System.Object, mscorlib, Version=4.0.0.0, Culture=neutral, PublicKeyToken=b77a5c561934e089\" }",
    m_ForcePreview=False,
    m_MaxItemsPreview=10000)
loadcase = Loadcase(Name="Dead Load", Nature=loadnature_2, Number="1", Component="BH.oM.Structure.Loads.Loadcase")
# DEAD LOAD
push_4 = Push(
    Adapter=adapter_strand7_5,
    Objects=flatten(loadcase),
    PushType="{ \"_t\" : \"System.Enum\", \"TypeName\" : { \"_t\" : \"System.Type\", \"Name\" : \"BH.oM.Adapter.PushType\" }, \"Value\" : \"AdapterDefault\" }",
    Active=push_3.Success,
    Component="{ .Push")  # -> Objects, Success
toggle = BooleanToggle(True)
Z_2 = UnitZ(Factor=1)
loadcaseinertiast7 = LoadCaseInertiaSt7(
    Loadcase=push_4.Objects,
    Direction=Z_2,
    StructuralMass=toggle,
    NonStructuralMass=toggle,
    Component="{ .LoadCaseInertiaSt7")
push_5 = Push(
    Adapter=adapter_strand7_5,
    Objects=flatten(loadcaseinertiast7),
    PushType="{ \"_t\" : \"System.Enum\", \"TypeName\" : { \"_t\" : \"System.Type\", \"Name\" : \"BH.oM.Adapter.PushType\" }, \"Value\" : \"AdapterDefault\" }",
    Active=push_4.Success,
    Component="{ .Push")  # -> Objects, Success

Z_3 = UnitZ(Factor="-1.5e3")

adapter_strand7_6 = BHoMAdapter(
    adapter_strand7,
    ObjectType="{ \"_t\" : \"System.Type\", \"Name\" : \"System.Object, mscorlib, Version=4.0.0.0, Culture=neutral, PublicKeyToken=b77a5c561934e089\" }",
    m_ForcePreview=False,
    m_MaxItemsPreview=10000)
loadcase_2 = Loadcase(Name="Live Load", Nature=loadnature_3, Number="2", Component="BH.oM.Structure.Loads.Loadcase")
# LOADING SLABS
push_6 = Push(
    Adapter=adapter_strand7_6,
    Objects=flatten(loadcase_2),
    PushType="{ \"_t\" : \"System.Enum\", \"TypeName\" : { \"_t\" : \"System.Type\", \"Name\" : \"BH.oM.Adapter.PushType\" }, \"Value\" : \"AdapterDefault\" }",
    Active=push_5.Success,
    Component="{ .Push")  # -> Objects, Success
areauniformlydistributedload = AreaUniformlyDistributedLoad(
    Loadcase=push_6.Objects,
    Pressure=Z_3,
    Objects=push_2.Objects,
    Axis="{ \"_t\" : \"System.Enum\", \"TypeName\" : { \"_t\" : \"System.Type\", \"Name\" : \"BH.oM.Structure.Loads.LoadAxis\" }, \"Value\" : \"Global\" }",
    Projected=False,
    Component="{ .AreaUniformlyDistributedLoad")
push_7 = Push(
    Adapter=adapter_strand7_6,
    Objects=flatten(areauniformlydistributedload),
    PushType="{ \"_t\" : \"System.Enum\", \"TypeName\" : { \"_t\" : \"System.Type\", \"Name\" : \"BH.oM.Adapter.PushType\" }, \"Value\" : \"AdapterDefault\" }",
    Active=push_6.Success,
    Component="{ .Push")  # -> Objects, Success

adapter_strand7_7 = BHoMAdapter(
    adapter_strand7,
    ObjectType="{ \"_t\" : \"System.Type\", \"Name\" : \"System.Object, mscorlib, Version=4.0.0.0, Culture=neutral, PublicKeyToken=b77a5c561934e089\" }",
    m_ForcePreview=False,
    m_MaxItemsPreview=10000)
loadcase_3 = Loadcase(Name="Wind Load", Nature=loadnature, Number="3", Component="BH.oM.Structure.Loads.Loadcase")
# LOADING COLUMNS
push_8 = Push(
    Adapter=adapter_strand7_7,
    Objects=flatten(loadcase_3),
    PushType="{ \"_t\" : \"System.Enum\", \"TypeName\" : { \"_t\" : \"System.Type\", \"Name\" : \"BH.oM.Adapter.PushType\" }, \"Value\" : \"AdapterDefault\" }",
    Active=push_7.Success,
    Component="{ .Push")  # -> Objects, Success
loadaxis = LoadAxis({"Global": 0, "Local": 1}, selected="Global", Component="BH.oM.Structure.Loads.LoadAxis", Selection=0)
vec = VectorXYZ(XComponent=0, YComponent=0, ZComponent=0)  # -> Vector, Length

X = UnitX(Factor="1.5")

baruniformlydistributedload = BarUniformlyDistributedLoad(
    Loadcase=push_8.Objects,
    Objects=cull,
    Force=X,
    Moment=vec.Vector,
    Axis=loadaxis,
    Projected=False,
    Component="{ .BarUniformlyDistributedLoad")
push_9 = Push(
    Adapter=adapter_strand7_7,
    Objects=flatten(baruniformlydistributedload),
    PushType="{ \"_t\" : \"System.Enum\", \"TypeName\" : { \"_t\" : \"System.Type\", \"Name\" : \"BH.oM.Adapter.PushType\" }, \"Value\" : \"AdapterDefault\" }",
    Active=push_8.Success,
    Component="{ .Push")  # -> Objects, Success

# ----
# SAVE and CLOSE
st7savefile = St7SaveFile(Active=push_9.Success, Component="{ .St7SaveFile")
st7closefile = St7CloseFile(Active=st7savefile, Component="{ .St7CloseFile")
